# Grasshopper definition Post DLA_Final.gh (Grasshopper 1.0.7)
# Copyright: Co-de-iT

# ---- group: opening ratios
close_to_attractor = Slider(0.25, range=0..0.5)
far_from_attractor = Slider(0.15, range=0..0.5)

# ----
# Creats a list of unique line
crv = Curve([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])

# ---- group: attractor curve
# Network preparation
crv_2 = Curve(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)

# ----
cluster = Cluster(network_lines=crv, connection_threshold=0)
# Avoid valence 2 nodes: generates further connections and ramifications to get rid of valence 2 nodes
number_slider = Slider(12, range=0..20)
cluster_2 = Cluster(network_lines=cluster, connection_threshold=number_slider)
# 3D network and core structure
crv_3 = Curve(cluster_2)
crv_4 = Curve(cluster_2)

# ---- group: solves network topology
topo = Topologizer(line_network=crv_4)  # -> points, line_to_point_connection, point_to_point_connections, point_line_data

# ---- group: find valence 1 nodes (terminals)
lng = ListLength(List=topo.point_line_data)
equals = Equality(FirstNumber=lng, SecondNumber="1")  # -> flatten(Equality), flatten(Inequality)
listindexes = CSharpScript(D=topo.points)  # -> ind; inputs D: list; same code as c_script
cull = CullPattern(List=listindexes, CullPattern=equals.Inequality)

# ---- group: sort line sequence around nodes
curvepoint = PointOnCurve(crv_4, parameter=0.5)
int = Integer(topo.point_line_data)
item = ListItem(List=curvepoint, Index=int, Wrap=True)
f_ptsbyang = SortPointsByAngle(points=item)  # -> angles, points_2, points_indexes
item_2 = ListItem(List=int, Index=simplify(f_ptsbyang.points_indexes), Wrap=True)

# ----
panel = Panel("2")

# ---- group: assign nodes values by curve attractor
pt = Point(topo.points)
crv_cp = CurveClosestPoint(Point=pt, Curve=crv_2)  # -> Point, Parameter, Distance
num = Number(crv_cp.Distance)
bnd = Bounds(Numbers=flatten(num))
remap = RemapNumbers(Value=num, Source=bnd, Target=Domain(0, 1))  # -> Mapped, Clipped
graph = GraphMapper(
    remap.Mapped,
    x0=0,
    x1=1,
    y0=0,
    y1=1,
    container_name="Bezier",
    cpx=[0, 0.4569215775, 0.4077289999, 1],
    cpy=[0.05507361889, 0.1914000511, 0.9511650205, 1])
subtraction = Subtraction(A="1.01", B=graph)
dots = DotDisplay(Point=pt, Colour=RGB(0, 0, 0), Size=subtraction)

# ---- group: network tags / lines index tags
pt_2 = Point(curvepoint)
c_script = CSharpScript(D=pt_2)  # -> ind; inputs D: list; same code as c_script
tag = TextTag3D(
    Location=pt_2,
    Text=c_script,
    Size=Slider(0.15, range=0..1),
    Colour=ColourSwatch(SwatchColor=RGB(255, 0, 238)),
    Justification=5)

# ---- group: network tags / nodes index tags
pt_3 = Point(topo.points)
c_script_2 = CSharpScript(D=pt_3)  # -> ind; inputs D: list; same code as c_script
tag_2 = TextTag3D(
    Location=pt_3,
    Text=c_script_2,
    Size=Slider(0.25, range=0..1),
    Colour=ColourSwatch(SwatchColor=RGB(0, 0, 0)),
    Justification=5)

# ---- group: create node openings / linear segments
num_2 = Number(graph)
bnd_2 = Bounds(Numbers=flatten(num_2))
dom = ConstructDomain(DomainStart=close_to_attractor, DomainEnd=far_from_attractor)
remap_2 = RemapNumbers(Value=num_2, Source=bnd_2, Target=dom)  # -> Mapped, Clipped
item_3 = ListItem(List=remap_2.Mapped, Index=topo.line_to_point_connection, Wrap=True)
item_4 = ListItem(List=item_3, Index=0, Wrap=True)  # -> Item, Item1
subtraction_2 = Subtraction(A="1", B=item_4.Item1)
crv_5 = Curve(simplify(graft(crv_4)))
dom_2 = ConstructDomain(DomainStart=item_4.Item, DomainEnd=subtraction_2)
subcrv = SubCurve(BaseCurve=crv_5, Domain=dom_2)  # -> simplify(Curve)

# ----
panel_2 = Panel(topo.points)
sort = SortList(Keys=panel_2)  # -> Keys, ValuesA
dispatch = Dispatch(List=listindexes, DispatchPattern=equals.Inequality)  # -> ListA, ListB
# separate nodes with valence 1 (terminals) fom all other nodes
pt_4 = Point(simplify(graft(topo.points)))

# ---- group: sort linear segments direction by node / sort curves by node
item_5 = ListItem(List=flatten(subcrv), Index=item_2, Wrap=True)  # -> simplify(Item)

# ---- group: sort linear segments direction by node
end = EndPoints(Curve=item_5)  # -> Start, End
dist = Distance(PointA=end.Start, PointB=pt_4)
dist_2 = Distance(PointA=end.End, PointB=pt_4)
larger = LargerThan(FirstNumber=dist, SecondNumber=dist_2)  # -> LargerThan, OrEqualTo
dispatch_2 = Dispatch(List=item_5, DispatchPattern=larger.LargerThan)  # -> ListA, ListB
flip = FlipCurve(Curve=dispatch_2.ListA)  # -> Curve, Flag
weave = Weave(Pattern=larger.LargerThan, Stream0=dispatch_2.ListB, Stream1=flip.Curve, NullGaps=False)

# ---- group: non-terminal nodes
# Sort nodes, links and terminals
branch = TreeBranch(Tree=pt_4, Path=dispatch.ListA, MaintainPaths=True)

# ---- group: linear links
crv_6 = Curve(weave)

# ----
branch_2 = TreeBranch(Tree=weave, Path=dispatch.ListA, MaintainPaths=True)

# ---- group: Points
end_2 = EndPoints(Curve=branch_2)  # -> Start, End

# ----
lng_2 = ListLength(List=end_2.Start)
smaller = SmallerThan(FirstNumber=lng_2, SecondNumber="2")  # -> SmallerThan, OrEqualTo
lng_3 = ListLength(List=end_2.Start)
dispatch_3 = Dispatch(List=end_2.Start, DispatchPattern=smaller.OrEqualTo)  # -> ListA, ListB
repeat = RepeatData(Data=branch, Length=lng_3)  # -> simplify(Data)

clean = CleanTree(RemoveNulls=True, RemoveInvalid=True, RemoveEmpty=False)  # disabled
crv_7 = Curve(clean)
trim = TrimTree(Tree=clean, Depth=1)
lng_4 = ListLength(List=trim)
smaller_2 = SmallerThan(FirstNumber=lng_4, SecondNumber="3")  # -> SmallerThan, OrEqualTo
dispatch_4 = Dispatch(List=clean, DispatchPattern=smaller_2.OrEqualTo)  # -> ListA, ListB
crv_8 = Curve(dispatch_4.ListA)

shift = ShiftList(List=end_2.Start, Shift=1, Wrap=True)  # -> simplify(List)

# ---- group: nodes figures
pline = PolyLine(Vertices=dispatch_3.ListB, Closed=True)

# ----
merge = Merge(Data1=graft(end_2.Start), Data2=graft(repeat), Data3=graft(shift))
srf = Surface(pline)
area = Area(Geometry=srf)  # -> Area, Centroid
pt_5 = Point(area.Centroid)
pt_6 = Point(pt_4)
pt_7 = Point(merge)
crv_9 = Curve(flatten(subcrv))

# ---- group: nodes curves
nurbs = NurbsCurve(Vertices=merge, Degree="2", Periodic=False)  # -> Curve, Length, Domain

# ---- group: Joint Definition
intcrv = Interpolate(Vertices=merge, Degree="1", Periodic=False, KnotStyle=1)  # -> Curve, Length, Domain
series = Series(Start="0.1", Step="0.1", Count=Slider(9, range=0..10))
tweencrv = TweenCurve(CurveA=nurbs.Curve, CurveB=intcrv.Curve, Factor=series, BlendType=0)
# Extrusions
fillet = Fillet(Curve=tweencrv, Radius="0.1")

# ----
patch = Patch(Points=panel_2, Spans=20, Flexibility=1, Trim=True)
merge_2 = Merge(Data1=flatten(fillet), Data2=flatten(nurbs.Curve), Data3=flatten(crv_9))

# ---- group: directional offset
curvepoint_2 = PointOnCurve(crv_9, parameter=0.5)
srf_cp = SurfaceClosestPoint(Point=curvepoint_2, Surface=patch)  # -> Point, UVPoint, Distance
evalsrf = EvaluateSurface(Surface=patch, Point=srf_cp.UVPoint)  # -> Point, Normal, UDirection, VDirection, Frame
xprod = CrossProduct(VectorA=crv_9, VectorB=evalsrf.Normal, Unitize="true")  # -> Vector, Length
amp = Amplitude(Vector=xprod.Vector, Amplitude=Slider(0.2, range=0..1))

# ----
join = JoinCurves(Curves=merge_2, Preserve=False)
rad = Radians(Degrees="-90")
pt_8 = Point(f_ptsbyang.points_2)
vrot = Rotate(Vector=amp, Axis=crv_9, Angle=rad)
extr = Extrude(Base=join, Direction=vrot)
rot3d = Rotate3D(Geometry=amp, Angle=rad, Center=pt_8, Axis=crv_9)  # -> Geometry, Transform

# ==== cluster SortPointsByAngle: Sorts a list of points by angle from their average point
plane = ClusterInput()  # reference Plane for sorting - leave empty for XY plane
points = ClusterInput()  # Ponts to sort
# froGH - a sparse collection of (in)utilities for Grasshopper
# 
#     froGH by Co-de-iT is licensed under a Creative Commons Attribution 4.0 International License.
#     http://creativecommons.org/licenses/by/4.0/
null = NullItem(Item=plane)  # -> NullFlags, InvalidFlags, Description
xy = XYPlane(Origin=Point(0, 0, 0))
expression = Expression(n=null.NullFlags, xy=xy, cp=plane, Expression="if(n,xy,cp)")
avr = Average(Input=points)
lng = ListLength(List=points)
deplane = DeconstructPlane(Plane=expression)  # -> Origin, XAxis, YAxis, ZAxis
vec2pt = Vector2Pt(PointA=avr, PointB=points, Unitize=False)  # -> Vector, Length
X = UnitX(Factor=1)
series = Series(Start=0, Step=1, Count=lng)
int = Integer(series)
f_vangsign = VectorAngleWithSign(V1=X, V2=vec2pt.Vector, Z=deplane.ZAxis)  # -> A; inputs V1: Vector3d, V2: Vector3d, Z: Vector3d
# ---------- f_vangsign: C# ----------
       /*
    froGH - a sparse collection of (in)utilities for Grasshopper

    Vector angle with Sign v 0.1
    code by Alessio Erioli

    froGH by Co-de-iT is licensed under a Creative Commons Attribution 4.0 International License.
    http://creativecommons.org/licenses/by/4.0/

    */
    initComp();
    // maps vector coordinates to the plane space
    if (Z.IsZero) Z = Vector3d.ZAxis;
    Plane p = new Plane(new Point3d(0, 0, 0), V1, Z);
    p.Rotate(-Math.PI * 0.5, V1);
    Point3d p1,p2;
    p.RemapToPlaneSpace((Point3d) V1, out p1);
    p.RemapToPlaneSpace((Point3d) V2, out p2);

    A = angSign((Vector3d) p1, (Vector3d) p2);
# ---------- f_vangsign: C# additional code ----------
  void initComp(){
    Component.Name = "Vector Angle with sign";
    Component.NickName = "f_VAngSign";
    Component.Description = "Computes angle between vectors with direction-dependent sign:\nclockwise is -, counter-clockwise is +";
    Component.Params.Input[0].Name = "Vector 1";
    Component.Params.Input[0].Description = "first vector";
    Component.Params.Input[1].Name = "Vector 2";
    Component.Params.Input[1].Description = "second vector";
    Component.Params.Input[2].Name = "Z axis";
    Component.Params.Input[2].Description = "Z axis of reference plane - keep empty for World Z";
    Component.Params.Output[0].Name = "Angle";
    Component.Params.Output[0].Description = "Angle (with sign) between vectors";
  }

  double angSign(Vector3d v1, Vector3d v2){
    v1.Unitize();
    v2.Unitize();
    return (System.Math.Atan2(v2.Y, v2.X) - System.Math.Atan2(v1.Y, v1.X));
  }
# ---------- end f_vangsign ----------
sort = SortList(Keys=f_vangsign, ValuesA=points, ValuesB=int)  # -> Keys, ValuesA, ValuesB
angles = ClusterOutput(sort.Keys)  # Sorted angles
points_2 = ClusterOutput(sort.ValuesA)  # Sorted points
points_indexes = ClusterOutput(sort.ValuesB)  # Sorted indexes

# ==== cluster Topologizer: Line network topology solver
line_network = ClusterInput()  # Network of unique lines, all meeting only at end points

end = EndPoints(Curve=line_network)  # -> Start, End
merge = Merge(Data1=end.Start, Data2=end.End)  # -> flatten(Result)
cset = CreateSet(List=merge)  # -> Set, Map
mindex = MemberIndex(Set=cset.Set, Member=end.Start)  # -> Index, Count
# find topological connections
# (GH method by Alessio Erioli)
mindex_2 = MemberIndex(Set=cset.Set, Member=end.End)  # -> Index, Count

mindex_3 = MemberIndex(Set=end.Start, Member=cset.Set)  # -> simplify(Index), Count
mindex_4 = MemberIndex(Set=end.End, Member=cset.Set)  # -> simplify(Index), Count
lng = ListLength(List=cset.Set)
merge_2 = Merge(Data1=mindex.Index, Data2=mindex_2.Index)  # -> simplify(Result)
series = Series(Start=0, Step=1, Count=lng)
item = ListItem(List=merge_2, Index=0, Wrap=True)  # -> flatten(Item), flatten(Item1)
int = Integer(series)
merge_3 = Merge(Data1=mindex_3.Index, Data2=mindex_4.Index)
mindex_5 = MemberIndex(Set=item.Item1, Member=int)  # -> Index, Count
mindex_6 = MemberIndex(Set=item.Item, Member=int)  # -> Index, Count
item_2 = ListItem(List=item.Item, Index=mindex_5.Index, Wrap=True)
item_3 = ListItem(List=item.Item1, Index=mindex_6.Index, Wrap=True)
merge_4 = Merge(Data1=item_3, Data2=item_2)  # -> simplify(Result)
cset_2 = CreateSet(List=merge_4)  # -> Set, Map
points = ClusterOutput(cset.Set)
line_to_point_connection = ClusterOutput(merge_2)
point_to_point_connections = ClusterOutput(cset_2.Set)
point_line_data = ClusterOutput(merge_3)  # Connected lines to each node

# ==== cluster Cluster
network_lines = ClusterInput()
# Avoid valence 2 nodes: generates further connections and ramifications to get rid of valence 2 nodes
# 
# 
# Reasons:
# 
# . valence 2 nodes mess up the stripes loop, breaking the side alternance and compromising the system
# 
# . they look bad
connection_threshold = ClusterInput()
line = Line(network_lines)
topo = Topologizer(line_network=line)  # -> points, line_to_point_connection, point_to_point_connections, point_line_data

# ---- group: point valence
lng = ListLength(List=topo.point_line_data)

# ----
con = DelaunayEdges(Points=topo.points, Plane=PlaneXY(0, 0, 0))  # -> simplify(Connectivity), Edges
equals = Equality(FirstNumber=lng, SecondNumber="2")  # -> Equality, Inequality

# ---- group: indexes from list
c_script = CSharpScript(D=topo.points)  # -> ind; inputs D: list
# ---------- c_script: C# ----------
    int[] indexes = new int[D.Count];
    
    for (int i = 0; i < D.Count; i++) indexes[i] = i;
    
    ind = indexes;
# ---------- end c_script ----------

# ----
larger = LargerThan(FirstNumber=lng, SecondNumber="3")  # -> LargerThan, OrEqualTo
dispatch = Dispatch(List=graft(topo.points), DispatchPattern=equals.Equality)  # -> ListA, ListB
dispatch_2 = Dispatch(List=con.Connectivity, DispatchPattern=equals.Equality)  # -> ListA, ListB
dispatch_3 = Dispatch(List=c_script, DispatchPattern=flatten(larger.OrEqualTo))  # -> ListA, ListB
difference = SetDifference(SetA=dispatch_2.ListA, SetB=simplify(topo.point_to_point_connections))  # -> simplify(Union)
pt = Point(dispatch.ListA)
difference_2 = SetDifference(SetA=difference, SetB=simplify(dispatch_3.ListA))  # -> simplify(Union)
item = ListItem(List=topo.points, Index=difference_2, Wrap=True)
ln = Line(StartPoint=pt, EndPoint=item)
len = Length(Curve=ln)
smaller = SmallerThan(FirstNumber=len, SecondNumber=connection_threshold)  # -> SmallerThan, OrEqualTo
cull = CullPattern(List=ln, CullPattern=smaller.SmallerThan)  # -> simplify(List)
sort = SortList(Keys=cull, ValuesA=cull)  # -> Keys, ValuesA
item_2 = ListItem(List=sort.ValuesA, Index=0, Wrap=True)  # -> flatten(Item)
clean = CleanTree(RemoveNulls=True, RemoveInvalid=True, RemoveEmpty=False, Tree=item_2)
dupln = RemoveDuplicateLines(Lines=flatten([clean, line]), Tolerance=0.01)
line_network = ClusterOutput(dupln)
