# Grasshopper definition Grow DLA in 3D- base file-update 2- multiple seed points.gh (Grasshopper 1.0.7)
# plug-ins: Anemone

reset_loop = Button()
# _LOOP CONTROLS
repeats = Slider(0, range=0..2000)

# ----
# _PARAMETERS
particle_travel_speed = Slider(1, range=0..10)
aggregation_threshold = Slider(5, range=0..10)
boundary_growth = Slider(1.03, range=0..10)
branches = Slider(2, range=0..10)
boundary_sensitivity = Slider(30, range=0..50)
attractor_amplitude = Slider(4, range=0..100)

pt = Point([<point referenced from the Rhino model> x3])

# ---- group: initial boundary
# this is where you can start feeding in more precise information for particle generation
initial_radius = Slider(3, range=0..10)
pt_2 = ConstructPoint(XCoordinate="0", YCoordinate="0", ZCoordinate="0")
cir = Circle(Plane=pt_2, Radius=initial_radius)

# ---- group: generate random particle
date = ConstructDate(Year=2014, Month=8, Day=31, Hour=11, Minute=39, Second=11)
ddate = DeconstructDate(Date=date)  # -> Year, Month, Day, Hour, Minute, Second
# generate multiple walker particles to begin with?
ma = MassAddition(Input=[ddate.Year, ddate.Month, ddate.Day, ddate.Hour, ddate.Minute, ddate.Second])  # -> Result, PartialResults

# ---- group: SEED
pt_3 = Point(pt_2)

# ---- group: construct curve domain
domain = Domain(Domain(1, 100))
crvdom = CurveDomain(Curve=cir, Domain=domain)  # -> Curve, Domain

# ----
panel = Panel(ma.PartialResults)
divide = DivideCurve(Curve=cir, Count=Slider(1, range=0..100), Kinks=False)  # -> Points, Tangents, Parameters
random = Random(Range=divide.Points, Number="1", Seed="1")  # -> flatten(Random)

# ---- group: random walker particles
eval = EvaluateCurve(Curve=cir, Parameter=random)  # -> Point, Tangent, Angle

# ----
loop_start = LoopStart(N=repeats, T=reset_loop, POINTS=pt_3, BOUNDARY=cir, PARTICLES=eval.Point)  # -> port, Counter, flatten(POINTS), BOUNDARY, flatten(BRANCHES), flatten(PARTICLES)
panel_2 = Panel(loop_start.Counter)

# ---- group: retrieve seed point
pt_4 = Point(loop_start.POINTS)

# ---- group: retrieve walker list
pt_5 = Point(loop_start.PARTICLES)

# ---- group: distance/ random walker-seed
cp = ClosestPoint(Point=pt_5, Cloud=pt_4)  # -> ClosestPoint, CPIndex, Distance

# ----
smaller = SmallerThan(FirstNumber=cp.Distance, SecondNumber=aggregation_threshold)  # -> SmallerThan, flatten(OrEqualTo)
gate = StreamGate(Stream=pt_5, Gate=smaller.OrEqualTo)  # -> Target0, Target1
merge = Merge(Data1=gate.Target1, Data2=pt_4)

# ---- group: create walking direction
area = Area(Geometry=loop_start.BOUNDARY)  # -> Area, Centroid
vec2pt = Vector2Pt(PointA=gate.Target0, PointB=area.Centroid, Unitize=True)  # -> Vector, Length
amp = Amplitude(Vector=vec2pt.Vector, Amplitude=particle_travel_speed)
move = Move(Geometry=gate.Target0, Motion=amp)  # -> Geometry, Transform

# ----
crv_cp = CurveClosestPoint(Point=merge, Curve=loop_start.BOUNDARY)  # -> Point, Parameter, Distance
sort = SortList(Keys=crv_cp.Distance)  # -> Keys, ValuesA
item = ListItem(List=sort.Keys, Index=0, Wrap=True)
smaller_2 = SmallerThan(FirstNumber=item, SecondNumber=boundary_sensitivity)  # -> SmallerThan, OrEqualTo

ln = Line(StartPoint=gate.Target1, EndPoint=cp.ClosestPoint)
fspin = SpinForce(Plane=area.Centroid, Strength=Slider(100, range=0..100), Radius=5, Decay=2)
merge_2 = Merge(Data1=loop_start.BRANCHES, Data2=ln)
filter = StreamFilter(Gate=smaller.OrEqualTo, Stream0=pt_4, Stream1=merge)
gate_2 = StreamGate(Stream=loop_start.BOUNDARY, Gate=smaller_2.OrEqualTo)  # -> Target0, Target1

# ---- group: scale boundary
scale = Scale(Geometry=gate_2.Target1, Center=area.Centroid, Factor=boundary_growth)  # -> Geometry, Transform

# ----
divide_2 = DivideCurve(Curve=loop_start.BOUNDARY, Count=10, Kinks=False)  # -> Points, Tangents, Parameters

# ---- group: BOUNDARY
filter_2 = StreamFilter(Gate=smaller_2.OrEqualTo, Stream0=gate_2.Target0, Stream1=scale.Geometry)

# ---- group: walker particles on scaled boundary
crvdom_2 = CurveDomain(Curve=loop_start.BOUNDARY, Domain=domain)  # -> Curve, Domain
random_2 = Random(Range=divide_2.Points, Number=branches, Seed=loop_start.Counter)
eval_2 = EvaluateCurve(Curve=filter_2, Parameter=random_2)  # -> Point, Tangent, Angle

# ---- group: new walking particle
filter_3 = StreamFilter(Gate=smaller.OrEqualTo, Stream0=move.Geometry, Stream1=eval_2.Point)

# ----
or = GateOr(A=loop_start.Counter, B=reset_loop)

# ---- group: ATTRACTOR POINT
pt_6 = Point(Point(30.3683614, -24.13562893, 16.7577411))

# ----
division = Division(A=loop_start.Counter, B=attractor_amplitude)
crv = Curve(loop_start.BRANCHES)

loop_start_2 = LoopStart(Repeat=loop_start.Counter, Trigger=or, Data=filter_3)  # -> port, Counter, Data

vec2pt_2 = Vector2Pt(PointA=loop_start_2.Data, PointB=pt_6, Unitize=False)  # -> Vector, Length
amp_2 = Amplitude(Vector=vec2pt_2.Vector, Amplitude=division)
move_2 = Move(Geometry=loop_start_2.Data, Motion=amp_2)  # -> Geometry, Transform

running = Running(port=loop_start_2.port, Exit=False, Data=move_2.Geometry, TimeOutVal=0, pausedState=False, state="Constant output")

loop_end = LoopEnd(
    port=loop_start.port,
    Exit=False,
    POINTS=flatten(filter),
    BOUNDARY=flatten(filter_2),
    BRANCHES=flatten(merge_2),
    PARTICLES=flatten(running),
    TimeOutVal=0,
    pausedState=False,
    state="Constant & Record")  # -> POINTS, BOUNDARY, BRANCHES, PARTICLES
