# Grasshopper definition Grow DLA in 3D- base file-update 2- single stream.gh (Grasshopper 1.0.7)
# plug-ins: Anemone

reset_loop = Button()
# _LOOP CONTROLS
repeats = Slider(205, range=0..2000)

attractor_amplitude = Slider(1, range=0..100)
# _PARAMETERS
particle_travel_speed = Slider(8, range=0..10)
aggregation_threshold = Slider(10, range=0..10)
boundary_growth = Slider(1.03, range=0..10)
branches = Slider(7, range=0..10)
boundary_sensitivity = Slider(27.04, range=0..50)

pt = Point([Point(-11.17918504, 112.2966808, 0), Point(-76.90747489, -27.8387607, 0), Point(70.50713105, -78.12079003, 0)])

# ---- group: initial boundary
# this is where you can start feeding in more precise information for particle generation
initial_radius = Slider(3, range=0..10)
pt_2 = ConstructPoint(XCoordinate="0", YCoordinate="0", ZCoordinate="0")
cir = Circle(Plane=pt_2, Radius=initial_radius)

# ---- group: generate random particle
date = ConstructDate(Year=2014, Month=8, Day=31, Hour=11, Minute=39, Second=11)
ddate = DeconstructDate(Date=date)  # -> Year, Month, Day, Hour, Minute, Second
# generate multiple walker particles to begin with?
ma = MassAddition(Input=[ddate.Year, ddate.Month, ddate.Day, ddate.Hour, ddate.Minute, ddate.Second])  # -> Result, PartialResults

# ---- group: SEED
pt_3 = Point(pt_2)

# ---- group: construct curve domain
domain = Domain(Domain(1, 100))
crvdom = CurveDomain(Curve=cir, Domain=domain)  # -> Curve, Domain

# ----
divide = DivideCurve(Curve=cir, Count=10, Kinks=False)  # -> Points, Tangents, Parameters
panel = Panel(ma.PartialResults)
random = Random(Range=divide.Points, Number="1", Seed="1")  # -> flatten(Random)

# ---- group: random walker particles
eval = EvaluateCurve(Curve=cir, Parameter=random)  # -> Point, Tangent, Angle

# ----
loop_start = LoopStart(N=repeats, T=reset_loop, POINTS=pt_3, BOUNDARY=cir, PARTICLES=eval.Point)  # -> port, Counter, flatten(POINTS), BOUNDARY, BRANCHES, flatten(PARTICLES)
panel_2 = Panel(loop_start.Counter)

# ---- group: retrieve seed point
pt_4 = Point(loop_start.POINTS)

# ---- group: retrieve walker list
pt_5 = Point(loop_start.PARTICLES)

# ---- group: distance/ random walker-seed
cp = ClosestPoint(Point=pt_5, Cloud=pt_4)  # -> ClosestPoint, CPIndex, Distance

# ----
smaller = SmallerThan(FirstNumber=cp.Distance, SecondNumber=aggregation_threshold)  # -> SmallerThan, flatten(OrEqualTo)
gate = StreamGate(Stream=pt_5, Gate=smaller.OrEqualTo)  # -> Target0, Target1

# ---- group: create walking direction
area = Area(Geometry=loop_start.BOUNDARY)  # -> Area, Centroid
vec2pt = Vector2Pt(PointB=area.Centroid, Unitize=True)  # -> Vector, Length
amp = Amplitude(Amplitude=particle_travel_speed)
move = Move(Geometry=gate.Target0, Motion=amp)  # -> Geometry, Transform

# ----
merge = Merge(Data1=gate.Target1, Data2=pt_4)

crv_cp = CurveClosestPoint(Point=merge, Curve=loop_start.BOUNDARY)  # -> Point, Parameter, Distance
sort = SortList(Keys=crv_cp.Distance)  # -> Keys, ValuesA
item = ListItem(List=sort.Keys, Index=0, Wrap=True)
smaller_2 = SmallerThan(FirstNumber=item, SecondNumber=boundary_sensitivity)  # -> SmallerThan, OrEqualTo

ln = Line(StartPoint=gate.Target1, EndPoint=cp.ClosestPoint)
merge_2 = Merge(Data1=loop_start.BRANCHES, Data2=ln)
filter = StreamFilter(Gate=smaller.OrEqualTo, Stream0=pt_4, Stream1=merge)
gate_2 = StreamGate(Stream=loop_start.BOUNDARY, Gate=smaller_2.OrEqualTo)  # -> Target0, Target1

# ---- group: scale boundary
scale = Scale(Geometry=gate_2.Target1, Center=area.Centroid, Factor=boundary_growth)  # -> Geometry, Transform

# ---- group: BOUNDARY
filter_2 = StreamFilter(Gate=smaller_2.OrEqualTo, Stream0=gate_2.Target0, Stream1=scale.Geometry)

# ---- group: walker particles on scaled boundary
crvdom_2 = CurveDomain(Curve=loop_start.BOUNDARY, Domain=domain)  # -> Curve, Domain
random_2 = Random(Range=crvdom_2.Domain, Number=branches, Seed=loop_start.Counter)
eval_2 = EvaluateCurve(Curve=filter_2, Parameter=random_2)  # -> Point, Tangent, Angle

# ---- group: new walking particle
filter_3 = StreamFilter(Gate=smaller.OrEqualTo, Stream0=move.Geometry, Stream1=eval_2.Point)

# ----
number_slider = Slider(13, range=0..100)
or = GateOr(A=loop_start.Counter, B=reset_loop)

# ---- group: ATTRACTOR POINT
pt_6 = Point(Point(-21.60555851, 3.466180305, 31.76242527))

# ----
fspin = SpinForce(Plane=pt_6, Strength=number_slider, Radius=number_slider, Decay=2)
mergef = MergeFields(Fields=fspin)
division = Division(A=loop_start.Counter, B=attractor_amplitude)
crv = Curve(loop_start.BRANCHES)

loop_start_2 = LoopStart(Repeat=loop_start.Counter, Trigger=or, Data=filter_3)  # -> port, Counter, Data

evf = EvaluateField(Field=mergef, Point=loop_start_2.Data)  # -> Tensor, Strength
vec2pt_2 = Vector2Pt(PointA=loop_start_2.Data, PointB=evf.Tensor, Unitize=False)  # -> Vector, Length
amp_2 = Amplitude(Vector=vec2pt_2.Vector, Amplitude=division)
move_2 = Move(Geometry=loop_start_2.Data, Motion=evf.Tensor)  # -> Geometry, Transform
move_3 = Move(Geometry=move_2.Geometry, Motion=evf.Tensor)  # -> Geometry, Transform

loop_end = LoopEnd(port=loop_start_2.port, Exit=False, Data=move_2.Geometry, TimeOutVal=0, pausedState=False, state="Constant output")

running = Running(
    port=loop_start.port,
    Exit=False,
    POINTS=flatten(filter),
    BOUNDARY=flatten(filter_2),
    BRANCHES=flatten(merge_2),
    PARTICLES=flatten(loop_end),
    TimeOutVal=0,
    pausedState=False,
    state="Constant & Record")  # -> POINTS, BOUNDARY, BRANCHES, PARTICLES
