# Grasshopper definition Grow DLA in 3D- base file.gh (Grasshopper 1.0.7)
# plug-ins: Anemone

reset_loop = Button()
# _LOOP CONTROLS
repeats = Slider(1500, range=0..2000)

# ----
# _PARAMETERS
particle_travel_speed = Slider(8, range=0..10)
aggregation_threshold = Slider(2, range=0..10)
boundary_growth = Slider(2, range=0..10)
branches = Slider(2, range=0..10)

# ---- group: initial boundary
# this is where you can start feeding in more precise information for particle generation
initial_radius = Slider(3, range=0..10)
pt = ConstructPoint(XCoordinate="0", YCoordinate="0", ZCoordinate="0")
cir = Circle(Plane=pt, Radius=initial_radius)

# ---- group: generate random particle
date = ConstructDate(Year=2014, Month=8, Day=31, Hour=11, Minute=39, Second=11)
ddate = DeconstructDate(Date=date)  # -> Year, Month, Day, Hour, Minute, Second
# generate multiple walker particles to begin with?
ma = MassAddition(Input=[ddate.Year, ddate.Month, ddate.Day, ddate.Hour, ddate.Minute, ddate.Second])  # -> Result, PartialResults

# ---- group: SEED
pt_2 = Point(pt)

# ---- group: construct curve domain
domain = Domain(Domain(1, 100))
crvdom = CurveDomain(Curve=cir, Domain=domain)  # -> Curve, Domain

# ----
panel = Panel(ma.PartialResults)
random = Random(Range=crvdom.Domain, Number="1", Seed=ma.PartialResults)  # -> flatten(Random)

# ---- group: random walker particles
eval = EvaluateCurve(Curve=cir, Parameter=random)  # -> Point, Tangent, Angle

# ----
loop_start = LoopStart(N=repeats, T=reset_loop, POINTS=pt_2, BOUNDARY=cir, PARTICLES=eval.Point)  # -> port, Counter, flatten(POINTS), BOUNDARY, BRANCHES, flatten(PARTICLES)
panel_2 = Panel(loop_start.Counter)

# ---- group: retrieve seed point
pt_3 = Point(loop_start.POINTS)

# ---- group: retrieve walker list
pt_4 = Point(loop_start.PARTICLES)

# ---- group: distance/ random walker-seed
cp = ClosestPoint(Point=pt_4, Cloud=pt_3)  # -> ClosestPoint, CPIndex, Distance

# ----
smaller = SmallerThan(FirstNumber=cp.Distance, SecondNumber=aggregation_threshold)  # -> SmallerThan, flatten(OrEqualTo)
gate = StreamGate(Stream=pt_4, Gate=smaller.OrEqualTo)  # -> Target0, Target1
merge = Merge(Data1=gate.Target1, Data2=pt_3)

# ---- group: create walking direction
area = Area(Geometry=loop_start.BOUNDARY)  # -> Area, Centroid
vec2pt = Vector2Pt(PointA=gate.Target0, PointB=area.Centroid, Unitize=True)  # -> Vector, Length
amp = Amplitude(Vector=vec2pt.Vector, Amplitude=particle_travel_speed)
move = Move(Geometry=gate.Target0, Motion=amp)  # -> Geometry, Transform

# ----
ln = Line(StartPoint=gate.Target1, EndPoint=cp.ClosestPoint)

crv_cp = CurveClosestPoint(Point=merge, Curve=loop_start.BOUNDARY)  # -> Point, Parameter, Distance
sort = SortList(Keys=crv_cp.Distance)  # -> Keys, ValuesValuesA
item = ListItem(List=sort.Keys, Index=0, Wrap=True)
smaller_2 = SmallerThan(FirstNumber=item, SecondNumber=Slider(2, range=0..10))  # -> SmallerThan, OrEqualTo

merge_2 = Merge(Data1=loop_start.BRANCHES, Data2=ln)
filter = StreamFilter(Gate=smaller.OrEqualTo, Stream0=pt_3, Stream1=merge)

# ---- group: scale boundary
scale = Scale(Geometry=loop_start.BOUNDARY, Center=area.Centroid, Factor=boundary_growth)  # -> Geometry, Transform

# ----
gate_2 = StreamGate(Stream=loop_start.BOUNDARY, Gate=smaller_2.OrEqualTo)  # -> Target0, Target1

# ---- group: BOUNDARY
filter_2 = StreamFilter(Gate=smaller_2.OrEqualTo, Stream0=gate_2.Target0, Stream1=scale.Geometry)

# ---- group: walker particles on scaled boundary
crvdom_2 = CurveDomain(Curve=loop_start.BOUNDARY, Domain=domain)  # -> Curve, Domain
random_2 = Random(Range=crvdom_2.Domain, Number=branches, Seed=loop_start.Counter)
eval_2 = EvaluateCurve(Curve=filter_2, Parameter=random_2)  # -> Point, Tangent, Angle

# ---- group: new walking particle
filter_3 = StreamFilter(Gate=smaller.OrEqualTo, Stream0=move.Geometry, Stream1=eval_2.Point)

# ----
or = GateOr(A=loop_start.Counter, B=reset_loop)
amplitude_to_attractor = Slider(41, range=0..100)

# ---- group: ATTRACTOR POINT
pt_5 = Point(Point(2.874158993, -36.99075627, 29.91104551))

# ----
division = Division(A=loop_start.Counter, B=amplitude_to_attractor)
crv = Curve(loop_start.BRANCHES)

loop_start_2 = LoopStart(Repeat=loop_start.Counter, Trigger=or, Data=filter_3)  # -> port, Counter, Data

vec2pt_2 = Vector2Pt(PointA=loop_start_2.Data, PointB=pt_5, Unitize=False)  # -> Vector, Length
amp_2 = Amplitude(Vector=vec2pt_2.Vector, Amplitude=division)
move_2 = Move(Geometry=loop_start_2.Data, Motion=amp_2)  # -> Geometry, Transform

running = Running(port=loop_start_2.port, Exit=False, Data=move_2.Geometry, TimeOutVal=0, pausedState=False, state="Constant output")

running_2 = Running(
    port=loop_start.port,
    Exit=False,
    POINTS=flatten(filter),
    BOUNDARY=flatten(filter_2),
    BRANCHES=flatten(merge_2),
    PARTICLES=flatten(running),
    TimeOutVal=0,
    pausedState=False,
    state="Constant & Record")  # -> POINTS, BOUNDARY, BRANCHES, PARTICLES
