# Grasshopper definition DLA 3D- Switch + grow towards.gh (Grasshopper 1.0.7)
# plug-ins: Anemone

reset_loop = Button()
# _LOOP CONTROLS
repeats = Slider(0, range=0..1000)

attractor_amplitude = Slider(1, range=0..100)
boundary_growth = Slider(1.03, range=0..10)
# _PARAMETERS
particle_travel_speed = Slider(50, range=0..50)
branches = Slider(10, range=0..10)
boundary_sensitivity = Slider(20, range=0..50)
aggregation_threshold = Slider(500, range=0..500)

# ---- group: MULTIPLE SEED POINTS
pt = Point(Point(-147.377138, 191.5414982, 0))

# ---- group: initial boundary
pt_2 = ConstructPoint(XCoordinate="0", YCoordinate="0", ZCoordinate="0")
initial_radius = Slider(20, range=0..100)
cir = Circle(Plane=pt, Radius=initial_radius)

# ---- group: cycle through attractor curves / ATTRACTOR CURVES
# divide count by 100 -> switch attractor curve every x
crv = Curve([<curve referenced from the Rhino model> x2])

# ---- group: SEED
pt_3 = Point(pt_2)

# ----
domain = Domain(Domain(0, 50))
number_slider = Slider(8824462, range=0..100000000)
dom = ConstructDomain(DomainStart=0, DomainEnd=number_slider)
random = Random(Range=domain, Number="1", Seed=number_slider)

# ---- group: random walker particles
eval = EvaluateCurve(Curve=cir, Parameter=random)  # -> Point, Tangent, Angle

# ----
loop_start = LoopStart(N=repeats, T=reset_loop, POINTS=pt, BOUNDARY=cir, PARTICLES=eval.Point)  # -> port, Counter, flatten(POINTS), BOUNDARY, BRANCHES, flatten(PARTICLES)
panel = Panel(loop_start.Counter)

# ---- group: cycle through attractor curves
loop_start_2 = LoopStart(Repeat=loop_start.Counter, Trigger=reset_loop, Field=crv)  # -> port, Counter, Field
division = Division(A=loop_start.Counter, B=Slider(100, range=0..100))
series = Series(Start=division, Step=1, Count=10)
lng = ListLength(List=series)
item = ListItem(List=crv, Index=division, Wrap=True)
division_2 = Division(A=lng, B=division)
series_2 = Series(Start=division, Step=division, Count=division_2)
crv_2 = Curve(item)
loop_end = LoopEnd(port=loop_start_2.port, Exit=False, Field=crv_2, TimeOutVal=0, pausedState=False, state="Constant output")
crv_3 = Curve(loop_end)

# ---- group: retrieve walker list
pt_4 = Point(loop_start.PARTICLES)

# ---- group: retrieve seed point
pt_5 = Point(loop_start.POINTS)

# ----
divide = DivideCurve(Curve=crv_3, Count=repeats, Kinks=False)  # -> Points, Tangents, Parameters

# ---- group: distance/ random walker-seed
cp = ClosestPoint(Point=pt_4, Cloud=pt_5)  # -> ClosestPoint, CPIndex, Distance

# ----
smaller = SmallerThan(FirstNumber=cp.Distance, SecondNumber=aggregation_threshold)  # -> SmallerThan, flatten(OrEqualTo)
gate = StreamGate(Stream=pt_4, Gate=smaller.OrEqualTo)  # -> Target0, Target1

# ---- group: create walking direction
area = Area(Geometry=loop_start.BOUNDARY)  # -> Area, Centroid
vec2pt = Vector2Pt(PointA=area.Centroid, PointB=area.Centroid, Unitize=True)  # -> Vector, Length
amp = Amplitude(Vector=vec2pt.Vector, Amplitude=1)
move = Move(Geometry=gate.Target0, Motion=amp)  # -> Geometry, Transform

# ----
merge = Merge(Data1=gate.Target1, Data2=pt_5)

crv_cp = CurveClosestPoint(Point=merge, Curve=loop_start.BOUNDARY)  # -> Point, Parameter, Distance
sort = SortList(Keys=crv_cp.Distance)  # -> Keys, ValuesA
item_2 = ListItem(List=sort.Keys, Index=0, Wrap=True)
smaller_2 = SmallerThan(FirstNumber=item_2, SecondNumber=boundary_sensitivity)  # -> SmallerThan, OrEqualTo

ln = Line(StartPoint=gate.Target1, EndPoint=cp.ClosestPoint)
merge_2 = Merge(Data1=loop_start.BRANCHES, Data2=ln)
filter = StreamFilter(Gate=smaller.OrEqualTo, Stream0=pt_5, Stream1=merge)

# ---- group: iterative attractor point
item_3 = ListItem(List=divide.Points, Index=loop_start.Counter, Wrap=True)  # -> Item, Item1

# ----
gate_2 = StreamGate(Stream=loop_start.BOUNDARY, Gate=smaller_2.OrEqualTo)  # -> Target0, Target1
item_4 = ListItem(List=loop_start.Counter, Index=0, Wrap=True)  # -> Item, Item1

# ---- group: scale boundary
scale = Scale(Geometry=gate_2.Target1, Center=area.Centroid, Factor=boundary_growth)  # -> Geometry, Transform

# ---- group: BOUNDARY
filter_2 = StreamFilter(Gate=smaller_2.OrEqualTo, Stream0=gate_2.Target0, Stream1=scale.Geometry)

# ----
dom_2 = ConstructDomain(DomainStart="0", DomainEnd=item_4.Item1)

# ---- group: walker particles on scaled boundary
random_2 = Random(Range=dom_2, Number=branches, Seed=loop_start.Counter)
eval_2 = EvaluateCurve(Curve=filter_2, Parameter=random_2)  # -> Point, Tangent, Angle

# ----
vec = Vector(item_3.Item)

# ---- group: new walking particle
filter_3 = StreamFilter(Gate=smaller.OrEqualTo, Stream0=move.Geometry, Stream1=eval_2.Point)

# ----
bang = ExplodeTree(Data=graft(filter_3))  # -> Branch0, Branch1
or = GateOr(A=loop_start.Counter, B=reset_loop)
division_3 = Division(A=loop_start.Counter, B=attractor_amplitude)
division_4 = Division(A=loop_start.Counter, B=attractor_amplitude)
crv_4 = Curve(loop_start.BRANCHES)

loop_start_3 = LoopStart(Repeat=loop_start.Counter, Trigger=or, Data=bang.Branch0)  # -> port, Counter, Data

vec2pt_2 = Vector2Pt(PointA=loop_start_3.Data, PointB=item_3.Item, Unitize=False)  # -> Vector, Length

# ---- group: ATTRACTOR POINT
pt_6 = Point(loop_start_3.Data)

# ----
loop_start_4 = LoopStart(Repeat=loop_start.Counter, Trigger=or, Data=bang.Branch1)  # -> port, Counter, Data

# ---- group: ATTRACTOR POINT
pt_7 = Point(loop_start_4.Data)

# ----
vec2pt_3 = Vector2Pt(PointA=loop_start_3.Data, PointB=pt_7, Unitize=False)  # -> Vector, Length
vec2pt_4 = Vector2Pt(PointA=loop_start_4.Data, PointB=pt_6, Unitize=False)  # -> Vector, Length
amp_2 = Amplitude(Vector=vec2pt_3.Vector, Amplitude=division_4)
amp_3 = Amplitude(Vector=vec2pt_4.Vector, Amplitude=division_3)
addition = Addition(A=amp_3, B=vec)
flip = FlipMatrix(Data=addition)
addition_2 = Addition(A=amp_2, B=vec)
merge_3 = Merge(Data1=amp_2, Data2=item_3.Item)  # -> flatten(Result)
move_2 = Move(Geometry=loop_start_4.Data, Motion=flip)  # -> Geometry, Transform
dist = Distance(PointA=pt_6, PointB=move_2.Geometry)
move_3 = Move(Geometry=loop_start_3.Data, Motion=addition_2)  # -> Geometry, Transform
equals = Equality(FirstNumber=dist, SecondNumber="0")  # -> Equality, Inequality
dist_2 = Distance(PointA=pt_7, PointB=move_3.Geometry)
equals_2 = Equality(FirstNumber=dist_2, SecondNumber="0")  # -> Equality, Inequality

loop_end_2 = LoopEnd(
    port=loop_start_3.port,
    Exit=equals_2.Inequality,
    Data=move_3.Geometry,
    TimeOutVal=0,
    pausedState=False,
    state="Constant output")

loop_end_3 = LoopEnd(
    port=loop_start_4.port,
    Exit=equals.Inequality,
    Data=move_2.Geometry,
    TimeOutVal=0,
    pausedState=False,
    state="Constant output")

merge_4 = Merge(Data1=loop_end_2, Data2=loop_end_3)
loop_end_4 = LoopEnd(
    port=loop_start.port,
    Exit=False,
    POINTS=flatten(filter),
    BOUNDARY=flatten(filter_2),
    BRANCHES=flatten(merge_2),
    PARTICLES=flatten(merge_4),
    TimeOutVal=0,
    pausedState=False,
    state="Constant & Record")  # -> POINTS, BOUNDARY, BRANCHES, PARTICLES
