# Grasshopper definition DLA- Fields _ constraints-update 2- double spin field.gh (Grasshopper 1.0.7)
# plug-ins: Anemone

# ----
# _LOOP CONTROLS
repeats = Slider(0, range=0..2000)
reset_loop = Button()

attractor_amplitude = Slider(2, range=0..100)
# _PARAMETERS
particle_travel_speed = Slider(100, range=0..100)
aggregation_threshold = Slider(50, range=0..50)
boundary_growth = Slider(1.03, range=0..10)
branches = Slider(5, range=0..10)
boundary_sensitivity = Slider(0.2, range=0..50)

# ---- group: MULTIPLE SEED POINTS
pt = Point([Point(-18.66505541, 4.629025861, 0), Point(1.538690497, 42.97821354, 0), Point(30.95027276, -1.069061553, 0)])

# ---- group: initial boundary
# this is where you can start feeding in more precise information for particle generation
initial_radius = Slider(50, range=0..50)
pt_2 = ConstructPoint(XCoordinate="0", YCoordinate="0", ZCoordinate="0")
cir = Circle(Plane=pt, Radius=initial_radius)

# ---- group: generate random particle
date = ConstructDate(Year=2014, Month=8, Day=31, Hour=11, Minute=39, Second=11)
ddate = DeconstructDate(Date=date)  # -> Year, Month, Day, Hour, Minute, Second
# generate multiple walker particles to begin with?
ma = MassAddition(Input=[ddate.Year, ddate.Month, ddate.Day, ddate.Hour, ddate.Minute, ddate.Second])  # -> Result, PartialResults

# ---- group: SEED
pt_3 = Point(pt)

# ----
divide = DivideCurve(Curve=cir, Count=10, Kinks=False)  # -> Points, Tangents, Parameters
panel = Panel(ma.PartialResults)
domain = Domain(Domain(0, 50))
random = Random(Range=domain, Number="1", Seed=ma.PartialResults)  # -> flatten(Random)

# ---- group: random walker particles
eval = EvaluateCurve(Curve=cir, Parameter=random)  # -> Point, Tangent, Angle

# ----
loop_start = LoopStart(N=repeats, T=reset_loop, POINTS=pt_3, BOUNDARY=cir, PARTICLES=eval.Point)  # -> port, Counter, flatten(POINTS), BOUNDARY, BRANCHES, flatten(PARTICLES)
panel_2 = Panel(loop_start.Counter)

# ---- group: retrieve seed point
pt_4 = Point(loop_start.POINTS)

# ---- group: retrieve walker list
pt_5 = Point(loop_start.PARTICLES)

# ---- group: distance/ random walker-seed
cp = ClosestPoint(Point=pt_5, Cloud=pt_4)  # -> ClosestPoint, CPIndex, Distance

# ----
smaller = SmallerThan(FirstNumber=cp.Distance, SecondNumber=aggregation_threshold)  # -> SmallerThan, flatten(OrEqualTo)
gate = StreamGate(Stream=pt_5, Gate=smaller.OrEqualTo)  # -> Target0, Target1

# ---- group: create walking direction
area = Area(Geometry=loop_start.BOUNDARY)  # -> Area, Centroid
vec2pt = Vector2Pt(PointA=area.Centroid, PointB=area.Centroid, Unitize=True)  # -> Vector, Length
amp = Amplitude(Vector=vec2pt.Vector, Amplitude=particle_travel_speed)
move = Move(Geometry=gate.Target0, Motion=amp)  # -> Geometry, Transform

# ----
merge = Merge(Data1=gate.Target1, Data2=pt_4)

crv_cp = CurveClosestPoint(Point=merge, Curve=loop_start.BOUNDARY)  # -> Point, Parameter, Distance
sort = SortList(Keys=crv_cp.Distance)  # -> Keys, ValuesA
item = ListItem(List=sort.Keys, Index=0, Wrap=True)
smaller_2 = SmallerThan(FirstNumber=item, SecondNumber=boundary_sensitivity)  # -> SmallerThan, OrEqualTo

ln = Line(StartPoint=gate.Target1, EndPoint=cp.ClosestPoint)
merge_2 = Merge(Data1=loop_start.BRANCHES, Data2=ln)
filter = StreamFilter(Gate=smaller.OrEqualTo, Stream0=pt_4, Stream1=merge)
gate_2 = StreamGate(Stream=loop_start.BOUNDARY, Gate=smaller_2.OrEqualTo)  # -> Target0, Target1
item_2 = ListItem(List=loop_start.Counter, Index=0, Wrap=True)  # -> Item, Item1

# ---- group: scale boundary
scale = Scale(Geometry=gate_2.Target1, Center=area.Centroid, Factor=boundary_growth)  # -> Geometry, Transform

# ----
dom = ConstructDomain(DomainStart="0", DomainEnd=item_2.Item1)

# ---- group: BOUNDARY
filter_2 = StreamFilter(Gate=smaller_2.OrEqualTo, Stream0=gate_2.Target0, Stream1=scale.Geometry)

# ---- group: walker particles on scaled boundary
random_2 = Random(Range=dom, Number=branches, Seed=loop_start.Counter)
eval_2 = EvaluateCurve(Curve=filter_2, Parameter=random_2)  # -> Point, Tangent, Angle

# ---- group: new walking particle
filter_3 = StreamFilter(Gate=smaller.OrEqualTo, Stream0=move.Geometry, Stream1=eval_2.Point)

# ----
number_slider = Slider(50, range=0..500)
number_slider_2 = Slider(100, range=0..200)
number_slider_3 = Slider(50, range=0..500)
or = GateOr(A=loop_start.Counter, B=reset_loop)

# ---- group: ATTRACTOR POINT
pt_6 = Point(<point referenced from the Rhino model>)

# ----
pln = Plane(pt_6)
X = UnitX(Factor=Slider(34, range=0..1000))
multiplication = Multiplication(A=X, B="-1")
number_slider_4 = Slider(60, range=0..100)
move_2 = Move(Geometry=pln, Motion=X)  # -> Geometry, Transform
yz = YZPlane(Origin=move_2.Geometry)
move_3 = Move(Geometry=move_2.Geometry, Motion=X)  # -> Geometry, Transform
yz_2 = YZPlane(Origin=move_3.Geometry)
fspin = SpinForce(Plane=pt_6, Strength=Slider(100, range=0..100), Radius=number_slider_3, Decay=2)
rot3d = Rotate3D(Geometry=yz, Angle=number_slider_4, Center=yz, Axis=Vector(0, 0, 1))  # -> Geometry, Transform
division = Division(A=loop_start.Counter, B=attractor_amplitude)
vec2pt_2 = Vector2Pt(PointA=pt_6, PointB=pt_6, Unitize=True)  # -> Vector, Length
line = LineSDL(Start=pt_6, Direction=Vector(0, 0, 1), Length=1)
fspin_2 = SpinForce(Plane=rot3d.Geometry, Strength=number_slider_2, Radius=number_slider_3, Decay=2)
rot3d_2 = Rotate3D(Geometry=yz_2, Angle=number_slider_4, Center=yz, Axis=Vector(0, 0, 1))  # -> Geometry, Transform
mergef = MergeFields(Fields=fspin)
fspin_3 = SpinForce(Plane=rot3d_2.Geometry, Strength=number_slider_2, Radius=number_slider_3, Decay=2)
mergef_2 = MergeFields(Fields=fspin_2)
mergef_3 = MergeFields(Fields=fspin_3)
gate_3 = StreamGate(Stream=number_slider_3, Gate=smaller_2.OrEqualTo)  # -> Target0, Target1
scale_2 = Scale(Geometry=gate_3.Target1, Center=area.Centroid, Factor=boundary_growth)  # -> Geometry, Transform
filter_4 = StreamFilter(Gate=smaller_2.OrEqualTo, Stream0=gate_3.Target0, Stream1=scale_2.Geometry)
crv = Curve(loop_start.BRANCHES)

loop_start_2 = LoopStart(N=loop_start.Counter, T=or, D0=filter_3)  # -> port, Counter, Data, Data_2

vec2pt_3 = Vector2Pt(PointA=loop_start_2.Data, PointB=pt_6, Unitize=False)  # -> Vector, Length
random_3 = Random(Range=Domain(-44, 44), Number=1, Seed=loop_start_2.Counter)
amp_2 = Amplitude(Vector=vec2pt_3.Vector, Amplitude=division)
rad = Radians(Degrees=random_3)
vrot = Rotate(Vector=vec2pt_2.Vector, Axis=line, Angle=rad)
evf = EvaluateField(Field=mergef, Point=loop_start_2.Data)  # -> Tensor, Strength
addition = Addition(A=vec2pt_2.Vector, B=vrot)
evf_2 = EvaluateField(Field=mergef_2, Point=loop_start_2.Data)  # -> Tensor, Strength
unit = UnitVector(Vector=addition)
vdis = VectorDisplay(Vector=evf.Tensor)
evf_3 = EvaluateField(Field=mergef_3, Point=loop_start_2.Data)  # -> Tensor, Strength
addition_2 = Addition(A=evf_2.Tensor, B=evf_3.Tensor)
addition_3 = Addition(A=evf.Tensor, B=addition_2)
addition_4 = Addition(A=addition_3, B=unit)
vdis_2 = VectorDisplay(Vector=addition_4)
addition_5 = Addition(A=amp_2, B=addition_4)
move_4 = Move(Geometry=loop_start_2.Data, Motion=addition_5)  # -> Geometry, Transform
dist = Distance(PointA=pt_6, PointB=move_4.Geometry)
equals = Equality(FirstNumber=dist, SecondNumber="0")  # -> Equality, Inequality

loop_end = LoopEnd(
    port=loop_start_2.port,
    Exit=equals.Inequality,
    Data=move_4.Geometry,
    VectorField=filter_4,
    TimeOutVal=0,
    pausedState=False,
    state="Constant output")  # -> D0, D1

loop_end_2 = LoopEnd(
    port=loop_start.port,
    Exit=False,
    POINTS=flatten(filter),
    BOUNDARY=flatten(filter_2),
    BRANCHES=flatten(merge_2),
    PARTICLES=flatten(loop_end.D0),
    TimeOutVal=0,
    pausedState=False,
    state="Constant & Record")  # -> POINTS, BOUNDARY, BRANCHES, PARTICLES
