# Grasshopper definition DLA- Multiple curve attractors- switch attractor-Update 1.gh (Grasshopper 1.0.7)
# plug-ins: Anemone

# ----
# _LOOP CONTROLS
repeats = Slider(0, range=-1..1000)
reset_loop = Button()

# ----
# _PARAMETERS
particle_travel_speed = Slider(50, range=0..50)
aggregation_threshold = Slider(100, range=0..100)
boundary_growth = Slider(1.03, range=0..10)
branches = Slider(5, range=0..10)
boundary_sensitivity = Slider(1, range=0..50)
attractor_amplitude = Slider(2, range=0..100)

# ---- group: cycle through attractor curves / ATTRACTOR CURVES
# divide count by 100 -> switch attractor curve every x
crv = Curve([<curve referenced from the Rhino model> x2])

# ---- group: MULTIPLE SEED POINTS
pt = Point(Point(-305.1864446, 37.30908057, 0))

# ---- group: initial boundary
pt_2 = ConstructPoint(XCoordinate="0", YCoordinate="0", ZCoordinate="0")
initial_radius = Slider(50, range=0..50)
cir = Circle(Plane=pt, Radius=initial_radius)

# ---- group: SEED
pt_3 = Point(pt_2)

# ----
toggle = BooleanToggle(False)
domain = Domain(Domain(0, 50))
number_slider = Slider(12323242, range=0..100000000)
dom = ConstructDomain(DomainStart=0, DomainEnd=number_slider)
random = Random(Range=domain, Number="1", Seed=number_slider)

# ---- group: random walker particles
eval = EvaluateCurve(Curve=cir, Parameter=random)  # -> Point, Tangent, Angle

# ----
loop_start = LoopStart(N=repeats, T=reset_loop, POINTS=pt, BOUNDARY=cir, PARTICLES=eval.Point)  # -> port, Counter, flatten(POINTS), BOUNDARY, BRANCHES, flatten(PARTICLES)
panel = Panel(loop_start.Counter)

# ---- group: cycle through attractor curves
loop_start_2 = LoopStart(Repeat=loop_start.Counter, Trigger=reset_loop, Field=crv)  # -> port, Counter, Field
division = Division(A=loop_start.Counter, B=Slider(100, range=0..100))
series = Series(Start=division, Step=1, Count=10)
lng = ListLength(List=series)
item = ListItem(List=crv, Index=division, Wrap=True)
division_2 = Division(A=lng, B=division)
series_2 = Series(Start=division, Step=division, Count=division_2)
crv_2 = Curve(item)
loop_end = LoopEnd(port=loop_start_2.port, Exit=False, Field=crv_2, TimeOutVal=0, pausedState=False, state="Constant output")
crv_3 = Curve(loop_end)

# ---- group: retrieve walker list
pt_4 = Point(loop_start.PARTICLES)

# ---- group: retrieve seed point
pt_5 = Point(loop_start.POINTS)

# ----
divide = DivideCurve(Curve=crv_3, Count=repeats, Kinks=False)  # -> Points, Tangents, Parameters

# ---- group: distance/ random walker-seed
cp = ClosestPoint(Point=pt_4, Cloud=pt_5)  # -> ClosestPoint, CPIndex, Distance

# ----
smaller = SmallerThan(FirstNumber=cp.Distance, SecondNumber=aggregation_threshold)  # -> SmallerThan, flatten(OrEqualTo)
gate = StreamGate(Stream=pt_4, Gate=smaller.OrEqualTo)  # -> Target0, Target1

# ---- group: create walking direction
area = Area(Geometry=loop_start.BOUNDARY)  # -> Area, Centroid
vec2pt = Vector2Pt(PointA=area.Centroid, PointB=area.Centroid, Unitize=True)  # -> Vector, Length
amp = Amplitude(Vector=vec2pt.Vector, Amplitude=1)
move = Move(Geometry=gate.Target0, Motion=amp)  # -> Geometry, Transform

# ----
merge = Merge(Data1=gate.Target1, Data2=pt_5)

crv_cp = CurveClosestPoint(Point=merge, Curve=loop_start.BOUNDARY)  # -> Point, Parameter, Distance
sort = SortList(Keys=crv_cp.Distance)  # -> Keys, ValuesA
item_2 = ListItem(List=sort.Keys, Index=0, Wrap=True)
smaller_2 = SmallerThan(FirstNumber=item_2, SecondNumber=boundary_sensitivity)  # -> SmallerThan, OrEqualTo

ln = Line(StartPoint=gate.Target1, EndPoint=cp.ClosestPoint)
merge_2 = Merge(Data1=loop_start.BRANCHES, Data2=ln)
filter = StreamFilter(Gate=smaller.OrEqualTo, Stream0=pt_5, Stream1=merge)
gate_2 = StreamGate(Stream=loop_start.BOUNDARY, Gate=smaller_2.OrEqualTo)  # -> Target0, Target1
item_3 = ListItem(List=loop_start.Counter, Index=0, Wrap=True)  # -> Item, Item1

# ---- group: scale boundary
scale = Scale(Geometry=gate_2.Target1, Center=area.Centroid, Factor=boundary_growth)  # -> Geometry, Transform

# ----
item_4 = ListItem(List=divide.Points, Index=loop_start.Counter, Wrap=True)  # -> Item, Item1

# ---- group: BOUNDARY
filter_2 = StreamFilter(Gate=smaller_2.OrEqualTo, Stream0=gate_2.Target0, Stream1=scale.Geometry)

# ----
dom_2 = ConstructDomain(DomainStart="0", DomainEnd=item_3.Item1)
item_5 = ListItem(Index=loop_start.Counter, Wrap=True)  # -> Item, Item1

# ---- group: walker particles on scaled boundary
random_2 = Random(Range=dom_2, Number=branches, Seed=loop_start.Counter)
eval_2 = EvaluateCurve(Curve=filter_2, Parameter=random_2)  # -> Point, Tangent, Angle

# ----
division_3 = Division(A=loop_start.Counter)

# ---- group: ATTRACTOR POINT
pt_6 = Point(item_4.Item)

# ---- group: new walking particle
filter_3 = StreamFilter(Gate=smaller.OrEqualTo, Stream0=move.Geometry, Stream1=eval_2.Point)

# ----
or = GateOr(A=loop_start.Counter, B=reset_loop)
division_4 = Division(A=loop_start.Counter, B=attractor_amplitude)
crv_4 = Curve(loop_start.BRANCHES)

loop_start_3 = LoopStart(Repeat=loop_start.Counter, Trigger=or, Data=filter_3)  # -> port, Counter, Data

vec2pt_2 = Vector2Pt(PointA=loop_start_3.Data, PointB=item_5.Item1, Unitize=False)  # -> Vector, Length
vec2pt_3 = Vector2Pt(PointA=loop_start_3.Data, PointB=pt_6, Unitize=False)  # -> Vector, Length

# ---- group: add spin force to Attractor
fspin = SpinForce(Plane=pt_6, Strength=Slider(50, range=0..100), Radius=Slider(100, range=0..100), Decay=2)
random_3 = Random(Range=Domain(-44, 44), Number=1, Seed=loop_start_3.Counter)
vec2pt_4 = Vector2Pt(PointA=random_3, PointB=pt_6, Unitize=True)  # -> Vector, Length
line = LineSDL(Start=pt_6, Direction=Vector(0, 0, 1), Length=1)
mergef = MergeFields(Fields=fspin)
rad = Radians(Degrees=random_3)
vrot = Rotate(Vector=vec2pt_4.Vector, Axis=line, Angle=rad)
evf = EvaluateField(Field=mergef, Point=loop_start_3.Data)  # -> Tensor, Strength
addition = Addition(A=vec2pt_4.Vector, B=vrot)
addition_2 = Addition(A=evf.Tensor)
unit = UnitVector(Vector=addition)
vdis = VectorDisplay(Vector=evf.Tensor)
addition_3 = Addition(A=addition_2, B=unit)
vdis_2 = VectorDisplay(Vector=addition_3)

# ----
merge_3 = Merge(Data1=vec2pt_3.Vector, Data2=vec2pt_2.Vector)
amp_2 = Amplitude(Vector=merge_3, Amplitude=division_4)
addition_4 = Addition(A=amp_2, B=addition_3)
move_2 = Move(Geometry=loop_start_3.Data, Motion=addition_4)  # -> Geometry, Transform
dist = Distance(PointA=pt_6, PointB=move_2.Geometry)
equals = Equality(FirstNumber=dist, SecondNumber="0")  # -> Equality, Inequality

loop_end_2 = LoopEnd(
    port=loop_start_3.port,
    Exit=equals.Inequality,
    Data=move_2.Geometry,
    TimeOutVal=0,
    pausedState=False,
    state="Constant output")

loop_end_3 = LoopEnd(
    port=loop_start.port,
    Exit=False,
    POINTS=flatten(filter),
    BOUNDARY=flatten(filter_2),
    BRANCHES=flatten(merge_2),
    PARTICLES=flatten(loop_end_2),
    TimeOutVal=0,
    pausedState=False,
    state="Constant & Record")  # -> POINTS, BOUNDARY, BRANCHES, PARTICLES
