# Grasshopper definition DLA- Multiple curve attractors- switch attractor.gh (Grasshopper 1.0.7)
# plug-ins: Anemone

# ----
# _LOOP CONTROLS
repeats = Slider(0, range=0..2000)
reset_loop = Button()

# ----
# _PARAMETERS
particle_travel_speed = Slider(50, range=0..50)
aggregation_threshold = Slider(10, range=0..10)
boundary_growth = Slider(1, range=0..10)
branches = Slider(2, range=0..10)
boundary_sensitivity = Slider(50, range=0..50)
attractor_amplitude = Slider(5, range=0..100)

# ---- group: ATTRACTOR CURVES
crv = Curve([<curve referenced from the Rhino model> x2])

# ---- group: MULTIPLE SEED POINTS
pt = Point(Point(-175.39261, 3.609338942, 0))

# ---- group: initial boundary
initial_radius = Slider(10, range=0..10)
pt_2 = ConstructPoint(XCoordinate="0", YCoordinate="0", ZCoordinate="0")
cir = Circle(Plane=pt, Radius=initial_radius)

# ---- group: SEED
pt_3 = Point(pt_2)

# ----
toggle = BooleanToggle(False)
domain = Domain(Domain(0, 360))
number_slider = Slider(12323242, range=0..100000000)
dom = ConstructDomain(DomainStart=0, DomainEnd=number_slider)
random = Random(Range=domain, Number="1", Seed=number_slider)

# ---- group: random walker particles
eval = EvaluateCurve(Curve=cir, Parameter=random)  # -> Point, Tangent, Angle

# ----
loop_start = LoopStart(N=repeats, T=reset_loop, POINTS=pt, BOUNDARY=cir, PARTICLES=eval.Point)  # -> port, Counter, flatten(POINTS), BOUNDARY, BRANCHES, flatten(PARTICLES)
panel = Panel(loop_start.Counter)
division = Division(A=loop_start.Counter, B=Slider(100, range=0..100))
loop_start_2 = LoopStart(Repeat=loop_start.Counter, Trigger=reset_loop, Field=crv)  # -> port, Counter, Field
random_2 = Random(Range=loop_start_2.Field, Number=1, Seed=division)
item = ListItem(List=crv, Index=random_2, Wrap=True)
crv_2 = Curve(item)
loop_end = LoopEnd(port=loop_start_2.port, Exit=False, Field=crv_2, TimeOutVal=0, pausedState=False, state="Constant output")
crv_3 = Curve(loop_end)
divide = DivideCurve(Curve=crv_3, Count=repeats, Kinks=False)  # -> Points, Tangents, Parameters

# ---- group: retrieve walker list
pt_4 = Point(loop_start.PARTICLES)

# ---- group: retrieve seed point
pt_5 = Point(loop_start.POINTS)

# ---- group: distance/ random walker-seed
cp = ClosestPoint(Point=pt_4, Cloud=pt_5)  # -> ClosestPoint, CPIndex, Distance

# ----
smaller = SmallerThan(FirstNumber=cp.Distance, SecondNumber=aggregation_threshold)  # -> SmallerThan, flatten(OrEqualTo)
gate = StreamGate(Stream=pt_4, Gate=smaller.OrEqualTo)  # -> Target0, Target1

# ---- group: create walking direction
area = Area(Geometry=loop_start.BOUNDARY)  # -> Area, Centroid
vec2pt = Vector2Pt(PointA=area.Centroid, PointB=area.Centroid, Unitize=True)  # -> Vector, Length
amp = Amplitude(Vector=vec2pt.Vector, Amplitude=1)
move = Move(Geometry=gate.Target0, Motion=amp)  # -> Geometry, Transform

# ----
merge = Merge(Data1=gate.Target1, Data2=pt_5)

crv_cp = CurveClosestPoint(Point=merge, Curve=loop_start.BOUNDARY)  # -> Point, Parameter, Distance
sort = SortList(Keys=crv_cp.Distance)  # -> Keys, ValuesA
item_2 = ListItem(List=sort.Keys, Index=0, Wrap=True)
smaller_2 = SmallerThan(FirstNumber=item_2, SecondNumber=boundary_sensitivity)  # -> SmallerThan, OrEqualTo

ln = Line(StartPoint=gate.Target1, EndPoint=cp.ClosestPoint)
merge_2 = Merge(Data1=loop_start.BRANCHES, Data2=ln)
filter = StreamFilter(Gate=smaller.OrEqualTo, Stream0=pt_5, Stream1=merge)
gate_2 = StreamGate(Stream=loop_start.BOUNDARY, Gate=smaller_2.OrEqualTo)  # -> Target0, Target1
item_3 = ListItem(List=loop_start.Counter, Index=0, Wrap=True)  # -> Item, Item1

# ---- group: scale boundary
scale = Scale(Geometry=gate_2.Target1, Center=area.Centroid, Factor=boundary_growth)  # -> Geometry, Transform

# ---- group: BOUNDARY
filter_2 = StreamFilter(Gate=smaller_2.OrEqualTo, Stream0=gate_2.Target0, Stream1=scale.Geometry)

# ----
dom_2 = ConstructDomain(DomainStart="0", DomainEnd=item_3.Item1)

# ---- group: walker particles on scaled boundary
random_3 = Random(Range=dom_2, Number=branches, Seed=loop_start.Counter)
eval_2 = EvaluateCurve(Curve=filter_2, Parameter=random_3)  # -> Point, Tangent, Angle

# ----
domain_2 = Domain(Domain(0, 1000))
division_2 = Division(A=loop_start.Counter, B=Slider(10, range=0..10))
division_3 = Division(A=loop_start.Counter)
Z = UnitZ(Factor=1)
random_4 = Random(Range=domain_2, Number=Slider(3, range=0..10), Seed=loop_start.Counter)
item_4 = ListItem(List=divide.Points, Index=loop_start.Counter, Wrap=True)  # -> Item, Item1
Z_2 = UnitZ(Factor=division_2)
item_5 = ListItem(Index=loop_start.Counter, Wrap=True)  # -> Item, Item1
pt_6 = ConstructPoint(XCoordinate=random_4, YCoordinate=random_4, ZCoordinate=random_4)

# ---- group: new walking particle
filter_3 = StreamFilter(Gate=smaller.OrEqualTo, Stream0=move.Geometry, Stream1=eval_2.Point)

# ----
or = GateOr(A=loop_start.Counter, B=reset_loop)

# ---- group: ATTRACTOR POINT
pt_7 = Point(item_4.Item1)

# ----
vec2pt_2 = Vector2Pt(PointA=pt_7, PointB=pt_6, Unitize=False)  # -> Vector, Length
vrot = Rotate(Vector=vec2pt_2.Vector, Axis=Z, Angle=degrees(random_4))
move_2 = Move(Geometry=pt_7, Motion=vrot)  # -> Geometry, Transform
division_4 = Division(A=loop_start.Counter, B=attractor_amplitude)
crv_4 = Curve(loop_start.BRANCHES)

loop_start_3 = LoopStart(Repeat=loop_start.Counter, Trigger=or, Data=filter_3)  # -> port, Counter, Data

vec2pt_3 = Vector2Pt(PointA=loop_start_3.Data, PointB=pt_7, Unitize=False)  # -> Vector, Length
vec2pt_4 = Vector2Pt(PointA=loop_start_3.Data, PointB=item_5.Item1, Unitize=False)  # -> Vector, Length
merge_3 = Merge(Data1=vec2pt_3.Vector, Data2=vec2pt_4.Vector)
amp_2 = Amplitude(Vector=merge_3, Amplitude=division_4)
move_3 = Move(Geometry=loop_start_3.Data, Motion=amp_2)  # -> Geometry, Transform
dist = Distance(PointA=pt_7, PointB=move_3.Geometry)
equals = Equality(FirstNumber=dist, SecondNumber="0")  # -> Equality, Inequality

loop_end_2 = LoopEnd(
    port=loop_start_3.port,
    Exit=equals.Inequality,
    Data=move_3.Geometry,
    TimeOutVal=0,
    pausedState=False,
    state="Constant output")

loop_end_3 = LoopEnd(
    port=loop_start.port,
    Exit=False,
    POINTS=flatten(filter),
    BOUNDARY=flatten(filter_2),
    BRANCHES=flatten(merge_2),
    PARTICLES=flatten(loop_end_2),
    TimeOutVal=0,
    pausedState=False,
    state="Constant & Record")  # -> POINTS, BOUNDARY, BRANCHES, PARTICLES
