# Grasshopper definition DLA-Final Set-up.gh (Grasshopper 1.0.7)
# plug-ins: Anemone

number_slider = Slider(5, range=0..10)
crv = Curve(<curve referenced from the Rhino model>)
cluster = Cluster()

reset_loop = Button()
# _LOOP CONTROLS
repeats = Slider(1500, range=0..2000)

boundary_growth = Slider(1.05, range=0..10)
attractor_amplitude = Slider(2, range=0..1000)
# _PARAMETERS
particle_travel_speed = Slider(50, range=0..50)
aggregation_threshold = Slider(9000, range=0..9000)
branches = Slider(50, range=0..100)
boundary_sensitivity = Slider(25, range=0..500)

area = Area(Geometry=crv)  # -> Area, Centroid
crv_2 = Curve(<curve referenced from the Rhino model>)

# ---- group: cycle through attractor curves / ATTRACTOR CURVES
crv_3 = Curve([<curve referenced from the Rhino model> x53])

# ----
random = Random(Range=Button(), Number=1, Seed=2)
scale_nu = ScaleNU(Geometry=crv_3, Plane=area.Centroid, ScaleX=number_slider, ScaleY=number_slider, ScaleZ=Slider(10, range=0..10))  # -> Geometry, Transform
pop2d = Populate2D(Region=crv_2, Count=100, Seed=1)  # -> flatten(Population)

# ---- group: MULTIPLE SEED POINTS
pt = Point([Point(-592.0588573, -3139.539264, 0), Point(-652.6507081, -2132.700903, 0), Point(657.8222478, -2612.177722, 0)])

# ---- group: initial boundary
pt_2 = ConstructPoint(XCoordinate="0", YCoordinate="0", ZCoordinate="0")
initial_radius = Slider(100, range=0..500)
cir = Circle(Plane=pt, Radius=initial_radius)

# ----
dom = ConstructDomain(DomainStart="0", DomainEnd="10")
jitter = Jitter(List=pop2d, Jitter=random, Seed=2)  # -> Values, Indices

# ---- group: SEED
pt_3 = Point(pt_2)

# ----
subset = SubList(List=jitter.Values, Domain=dom, Wrap=True)  # -> List, Index
toggle = BooleanToggle(False)
domain = Domain(Domain(0, 100))
number_slider_2 = Slider(8824462, range=0..100000000)
dom_2 = ConstructDomain(DomainStart=0, DomainEnd=number_slider_2)
random_2 = Random(Range=domain, Number="1", Seed=number_slider_2)

# ---- group: random walker particles
eval = EvaluateCurve(Curve=cir, Parameter=random_2)  # -> Point, Tangent, Angle

# ----
loop_start = LoopStart(N=repeats, T=reset_loop, POINTS=pt, BOUNDARY=cir, PARTICLES=eval.Point)  # -> port, Counter, flatten(POINTS), BOUNDARY, BRANCHES, flatten(PARTICLES)
panel = Panel(loop_start.Counter)

# ---- group: cycle through attractor curves
loop_start_2 = LoopStart(Repeat=loop_start.Counter, Trigger=reset_loop, Field=crv_3)  # -> port, Counter, Field
division = Division(A=loop_start.Counter, B=Slider(40, range=0..100))
series = Series(Start=division, Step=1, Count=10)
lng = ListLength(List=series)
item = ListItem(List=crv_3, Index=division, Wrap=True)
division_2 = Division(A=lng, B=division)
series_2 = Series(Start=division, Step=division, Count=division_2)
crv_4 = Curve(item)
loop_end = LoopEnd(port=loop_start_2.port, Exit=False, Field=crv_4, TimeOutVal=0, pausedState=False, state="Constant output")
crv_5 = Curve(loop_end)

# ---- group: retrieve walker list
pt_4 = Point(loop_start.PARTICLES)

# ---- group: retrieve seed point
pt_5 = Point(loop_start.POINTS)

# ---- group: distance/ random walker-seed
cp = ClosestPoint(Point=pt_4, Cloud=pt_5)  # -> ClosestPoint, CPIndex, Distance

# ----
smaller = SmallerThan(FirstNumber=cp.Distance, SecondNumber=aggregation_threshold)  # -> SmallerThan, flatten(OrEqualTo)
gate = StreamGate(Stream=pt_4, Gate=smaller.OrEqualTo)  # -> Target0, Target1

# ---- group: create walking direction
area_2 = Area(Geometry=loop_start.BOUNDARY)  # -> Area, Centroid
vec2pt = Vector2Pt(PointA=area_2.Centroid, PointB=area_2.Centroid, Unitize=True)  # -> Vector, Length
amp = Amplitude(Vector=vec2pt.Vector, Amplitude=1)
move = Move(Geometry=gate.Target0, Motion=amp)  # -> Geometry, Transform

# ----
merge = Merge(Data1=gate.Target1, Data2=pt_5)

crv_cp = CurveClosestPoint(Point=merge, Curve=loop_start.BOUNDARY)  # -> Point, Parameter, Distance
sort = SortList(Keys=crv_cp.Distance)  # -> Keys, ValuesA
item_2 = ListItem(List=sort.Keys, Index=0, Wrap=True)
smaller_2 = SmallerThan(FirstNumber=item_2, SecondNumber=boundary_sensitivity)  # -> SmallerThan, OrEqualTo

ln = Line(StartPoint=gate.Target1, EndPoint=cp.ClosestPoint)
merge_2 = Merge(Data1=loop_start.BRANCHES, Data2=ln)
filter = StreamFilter(Gate=smaller.OrEqualTo, Stream0=pt_5, Stream1=merge)
divide = DivideCurve(Curve=crv_5, Count=repeats, Kinks=False)  # -> Points, Tangents, Parameters
gate_2 = StreamGate(Stream=loop_start.BOUNDARY, Gate=smaller_2.OrEqualTo)  # -> Target0, Target1

# ---- group: iterative attractor point
item_3 = ListItem(List=divide.Points, Index=loop_start.Counter, Wrap=True)  # -> Item, Item1

# ----
item_4 = ListItem(List=loop_start.Counter, Index=0, Wrap=True)  # -> Item, Item1
vec = Vector(item_3.Item1)

# ---- group: scale boundary
scale = Scale(Geometry=gate_2.Target1, Center=area_2.Centroid, Factor=boundary_growth)  # -> Geometry, Transform

# ---- group: BOUNDARY
filter_2 = StreamFilter(Gate=smaller_2.OrEqualTo, Stream0=gate_2.Target0, Stream1=scale.Geometry)

# ----
dom_3 = ConstructDomain(DomainStart="0", DomainEnd=item_4.Item1)

# ---- group: walker particles on scaled boundary
random_3 = Random(Range=dom_3, Number=branches, Seed=loop_start.Counter)
eval_2 = EvaluateCurve(Curve=filter_2, Parameter=random_3)  # -> Point, Tangent, Angle

# ---- group: new walking particle
filter_3 = StreamFilter(Gate=smaller.OrEqualTo, Stream0=move.Geometry, Stream1=eval_2.Point)

# ----
or = GateOr(A=loop_start.Counter, B=reset_loop)
bang = ExplodeTree(Data=graft(filter_3))  # -> Branch0, Branch1, Branch2
division_3 = Division(A=loop_start.Counter, B=attractor_amplitude)
division_4 = Division(A=loop_start.Counter, B=attractor_amplitude)
division_5 = Division(A=loop_start.Counter, B=attractor_amplitude)
crv_6 = Curve(loop_start.BRANCHES)

loop_start_3 = LoopStart(Repeat=loop_start.Counter, Trigger=or, Data=bang.Branch2)  # -> port, Counter, Data

loop_start_4 = LoopStart(Repeat=loop_start.Counter, Trigger=or, Data=bang.Branch0)  # -> port, Counter, Data

# ---- group: ATTRACTOR POINT
pt_6 = Point(loop_start_4.Data)

pt_7 = Point(loop_start_4.Data)

# ----
vec2pt_2 = Vector2Pt(PointA=loop_start_3.Data, PointB=pt_6, Unitize=False)  # -> Vector, Length
amp_2 = Amplitude(Vector=vec2pt_2.Vector, Amplitude=division_3)
addition = Addition(A=amp_2, B=vec)
flip = FlipMatrix(Data=addition)
addition_2 = Addition(A=amp_2, B=flip)
move_2 = Move(Geometry=loop_start_3.Data, Motion=addition_2)  # -> Geometry, Transform
dist = Distance(PointA=pt_6, PointB=move_2.Geometry)
equals = Equality(FirstNumber=dist, SecondNumber="0")  # -> Equality, Inequality

loop_end_2 = LoopEnd(
    port=loop_start_3.port,
    Exit=equals.Inequality,
    Data=move_2.Geometry,
    TimeOutVal=0,
    pausedState=False,
    state="Constant output")

loop_start_5 = LoopStart(Repeat=loop_start.Counter, Trigger=or, Data=bang.Branch1)  # -> port, Counter, Data

# ---- group: ATTRACTOR POINT
pt_8 = Point(loop_start_5.Data)

# ----
vec2pt_3 = Vector2Pt(PointA=loop_start_4.Data, PointB=pt_8, Unitize=False)  # -> Vector, Length
vec2pt_4 = Vector2Pt(PointA=loop_start_5.Data, PointB=pt_7, Unitize=False)  # -> Vector, Length
amp_3 = Amplitude(Vector=vec2pt_3.Vector, Amplitude=division_4)
amp_4 = Amplitude(Vector=vec2pt_4.Vector, Amplitude=division_5)
addition_3 = Addition(A=amp_4, B=vec)
flip_2 = FlipMatrix(Data=addition_3)
addition_4 = Addition(A=amp_3, B=vec)
addition_5 = Addition(A=amp_4, B=flip_2)
move_3 = Move(Geometry=loop_start_5.Data, Motion=addition_5)  # -> Geometry, Transform
move_4 = Move(Geometry=loop_start_4.Data, Motion=addition_4)  # -> Geometry, Transform
dist_2 = Distance(PointA=pt_8, PointB=move_4.Geometry)
dist_3 = Distance(PointA=pt_7, PointB=move_3.Geometry)
equals_2 = Equality(FirstNumber=dist_2, SecondNumber="0")  # -> Equality, Inequality
equals_3 = Equality(FirstNumber=dist_3, SecondNumber="0")  # -> Equality, Inequality

loop_end_3 = LoopEnd(
    port=loop_start_4.port,
    Exit=equals_2.Inequality,
    Data=move_4.Geometry,
    TimeOutVal=0,
    pausedState=False,
    state="Constant output")

loop_end_4 = LoopEnd(
    port=loop_start_5.port,
    Exit=equals_3.Inequality,
    Data=move_3.Geometry,
    TimeOutVal=0,
    pausedState=False,
    state="Constant output")

merge_3 = Merge(Data1=loop_end_3, Data2=loop_end_4, Data3=loop_end_2)
loop_end_5 = LoopEnd(
    port=loop_start.port,
    Exit=False,
    POINTS=flatten(filter),
    BOUNDARY=flatten(filter_2),
    BRANCHES=flatten(merge_2),
    PARTICLES=flatten(merge_3),
    TimeOutVal=0,
    pausedState=False,
    state="Constant & Record")  # -> POINTS, BOUNDARY, BRANCHES, PARTICLES

# ==== cluster Cluster
number_slider = Slider(10, range=0..1000)
number_slider_2 = Slider(16, range=0..100)
number_slider_3 = Slider(3, range=0..10)
series = Series(Start=0, Step=number_slider, Count=number_slider_2)
sqgrid = Square(Plane=PlaneXY(0, 0, 0), Size=number_slider, ExtentX=number_slider_2, ExtentY=number_slider_2)  # -> Cells, Points
Z = UnitZ(Factor=series)
series_2 = Series(Start=Slider(3, range=0..10), Step=number_slider_3, Count=Slider(3, range=0..10))
move = Move(Geometry=graft(sqgrid.Points), Motion=Z)  # -> flatten(Geometry), Transform
item = ListItem(List=series_2, Index=0, Wrap=True)  # -> Item, Item1
series_3 = Series(Start=item.Item, Step=1, Count=number_slider_3)
series_4 = Series(Start=item.Item1, Step=1, Count=number_slider_3)
bbox = BoundingBox(Content=move.Geometry, Plane=PlaneXY(0, 0, 0), UnionBox=True)  # -> Box, Box_2
number_slider_4 = Slider(12, range=0..100)
random = Random(Range=Domain(0, 1), Number=number_slider_4, Seed=series_4)
random_2 = Random(Range=Domain(0, 1), Number=number_slider_4, Seed=series_3)
flip = FlipMatrix(Data=random_2)
flip_2 = FlipMatrix(Data=random)
item_2 = ListItem(List=flip_2, Index=0, Wrap=True)  # -> Item, Item1, Item2
item_3 = ListItem(List=flip, Index=0, Wrap=True)  # -> Item, Item1, Item2
pt = ConstructPoint(XCoordinate=item_3.Item, YCoordinate=item_3.Item1, ZCoordinate=item_3.Item2)
pt_2 = ConstructPoint(XCoordinate=item_2.Item, YCoordinate=item_2.Item1, ZCoordinate=item_2.Item2)
pop3d = Populate3D(Region=bbox.Box, Count=number_slider_4, Seed=Slider(74, range=0..100))
pl = ConstructPlane(Origin=graft(pop3d), XAxis=pt, YAxis=pt_2)
multiplication = Multiplication(A=number_slider, B=number_slider_2)
panel = Panel(multiplication)
fspin = SpinForce(Plane=pl, Strength=Slider(500, range=0..500), Radius=Slider(175, range=0..175), Decay=Slider(0, range=0..10))
mergef = MergeFields(Fields=flatten(fspin))
crv = Curve(<curve referenced from the Rhino model>)
number_slider_5 = Slider(7, range=0..20)
area = Area(Geometry=crv)  # -> Area, Centroid
fline = FieldLine(Field=mergef, Point=move.Geometry, Steps=Slider(58, range=0..100), Accuracy=Slider(2, range=0..10), Method=3)
scale_nu = ScaleNU(Geometry=fline, Plane=area.Centroid, ScaleX=number_slider_5, ScaleY=number_slider_5, ScaleZ=Slider(3, range=0..20))  # -> Geometry, Transform
reb = RebuildCurve(Curve=fline, Degree=Slider(1, range=0..10), Count=Slider(10, range=0..10), Tangents=False)
Z_2 = UnitZ(Factor=Slider(300, range=0..300))
C = ClusterOutput(reb)
move_2 = Move(Geometry=scale_nu.Geometry, Motion=Z_2)  # -> Geometry, Transform
len = Length(Curve=reb)
bnd = Bounds(Numbers=reb)
remap = RemapNumbers(Value=len, Source=bnd, Target=Domain(0, 1))  # -> Mapped, Clipped
gradient = Gradient(LowerLimit=0, UpperLimit=1, stops=[0.15: RGB(255, 130, 160), 0.85: RGB(220, 0, 40)])
gradient_2 = Gradient(
    LowerLimit=0,
    UpperLimit=1,
    Parameter=remap.Mapped,
    stops=[0: RGB(0, 128, 0), 0: RGB(29, 215, 201), 0.512: RGB(154, 205, 50), 0.829: RGB(0, 192, 192)])
varsweep = VariableSweep(Rail=reb, X=0.5, Y=0.5, Scale=[1, 0.4], Angle=0)  # disabled
mcol = MeshColours(Mesh=varsweep, Colours=gradient)
preview = CustomPreview(Geometry=reb, Material=gradient_2)
preview_2 = CustomPreview(Geometry=varsweep, Material=mcol)
